# Dynamo graph Rebar Check Schedule.dyn "Rebar Check Schedule v0.1" (Dynamo 2.0.2.6826)

code_block = CodeBlock { "BS_8666_Check_Assessment"; }
code_block_2 = CodeBlock { "BS_8666_Check_Comments"; }
code_block_3 = CodeBlock { "BS_8666_Check_Date"; }

# group: Create Schedule
categories = Categories(index=570)
code_block_4 = CodeBlock { "BS8666 Check Errors"; }
schedule_type = ScheduleTypes(index=2)
createSchedule = ScheduleView.CreateSchedule(category=categories, name=code_block_4, scheduleType=schedule_type)
schedulableFields = ScheduleView.SchedulableFields(scheduleView=createSchedule)
string_from_object = FromObject(obj=schedulableFields)
code_block_5 = CodeBlock { "Element"; }
code_block_6 = CodeBlock(a=code_block_5, b=code_block, c=code_block_2, d=code_block_3) { [a, b, c, d]; }
indexOf = List.IndexOf(list=string_from_object, element=code_block_6)
getItemAtIndex = List.GetItemAtIndex(list=schedulableFields, index=indexOf)
addFields = ScheduleView.AddFields(scheduleView=createSchedule, fields=getItemAtIndex)
fields = ScheduleView.Fields(scheduleView=addFields)
code_block_7 = CodeBlock(list=fields) { list[1]; }
schedule_filter_type = ScheduleFilterType(index=15)
code_block_8 = CodeBlock { "Okay"; }
byFieldTypeAndValue = Revit.Schedules.ScheduleFilter.ByFieldTypeAndValue(field=code_block_7, filterType=schedule_filter_type, value=code_block_8)
addFilters = ScheduleView.AddFilters(scheduleView=addFields, scheduleFilters=byFieldTypeAndValue)
