# Dynamo graph Rebar Check Selected Elements.dyn "Rebar Check - Selected Elements v0.6" (Dynamo 2.0.2.6826)

# group: Select Specific Elements
select_model_elements = DSModelElementsSelection()  # 287 picked in the model
getCategory = Element.GetCategory(element=select_model_elements)
string_from_object = FromObject(obj=getCategory)
filter = Python(IN[0]=select_model_elements, IN[1]=string_from_object)
# ---------- filter.python (19 lines) ----------
# Enable Python support and load DesignScript library
import clr
clr.AddReference('ProtoGeometry')
from Autodesk.DesignScript.Geometry import *

# The inputs to this node will be stored as a list in the IN variables.
dataEnteringNode = IN

# Place your code below this line
elements = IN[0]
category = IN[1]
output = []

for i in range(len(category)):
	if category[i].lower() == "structural rebar":
		output.append(elements[i])

# Assign your output to the OUT variable.
OUT = output
# ----------------------------------------

# group: Make Rebar Solid in View
current = Document.Current()
activeView = Document.ActiveView(document=current)
boolean = BoolSelector(true)
setSolidInView = Custom[Rebar.SetSolidInView](rebarElements=filter, views=activeView, solid=boolean)  # Sets this rebar element to be shown solidly in a 3D view.
boolean_2 = BoolSelector(true)
setUnobscuredInView = Custom[Rebar.SetUnobscuredInView](rebarElements=filter, views=activeView, unobscured=boolean_2)  # Sets this rebar element to be shown unobscured in a view.

# group: Extract Parameters
code_block = CodeBlock { "Shape"; }
parameterByName = Parameter.ParameterByName(element=filter, name=code_block)
code_block_2 = CodeBlock { "Type"; }
parameterByName_2 = Parameter.ParameterByName(element=filter, name=code_block_2)
code_block_3 = CodeBlock { "A"; }
parameterByName_3 = Parameter.ParameterByName(element=filter, name=code_block_3)
code_block_4 = CodeBlock { "B"; }
parameterByName_4 = Parameter.ParameterByName(element=filter, name=code_block_4)
code_block_5 = CodeBlock { "C"; }
parameterByName_5 = Parameter.ParameterByName(element=filter, name=code_block_5)
code_block_6 = CodeBlock { "D"; }
parameterByName_6 = Parameter.ParameterByName(element=filter, name=code_block_6)
code_block_7 = CodeBlock { "E"; }
parameterByName_7 = Parameter.ParameterByName(element=filter, name=code_block_7)
code_block_8 = CodeBlock { "F"; }
parameterByName_8 = Parameter.ParameterByName(element=filter, name=code_block_8)
code_block_9 = CodeBlock { "Bar Length"; }
parameterByName_9 = Parameter.ParameterByName(element=filter, name=code_block_9)
code_block_10 = CodeBlock { "R"; }
parameterByName_10 = Parameter.ParameterByName(element=filter, name=code_block_10)
code_block_11 = CodeBlock { "Distribution Type"; }
parameterByName_11 = Parameter.ParameterByName(element=filter, name=code_block_11)

# group: Data Conversion
string_from_object_2 = FromObject(obj=parameterByName)
code_block_12 = CodeBlock { 0; }
code_block_13 = CodeBlock { 8; }
remove = String.Remove(str=string_from_object_2, startIndex=code_block_12, count=code_block_13)
toNumber = String.ToNumber(str=remove)
string_from_object_3 = FromObject(obj=parameterByName_2)
code_block_14 = CodeBlock { 0; }
code_block_15 = CodeBlock { 8; }
remove_2 = String.Remove(str=string_from_object_3, startIndex=code_block_14, count=code_block_15)
toNumber_2 = String.ToNumber(str=remove_2)
value = Parameter.Value(parameter=parameterByName_3)
round = Math.Round(number=value)
value_2 = Parameter.Value(parameter=parameterByName_4)
round_2 = Math.Round(number=value_2)
value_3 = Parameter.Value(parameter=parameterByName_5)
round_3 = Math.Round(number=value_3)
value_4 = Parameter.Value(parameter=parameterByName_6)
round_4 = Math.Round(number=value_4)
value_5 = Parameter.Value(parameter=parameterByName_7)
round_5 = Math.Round(number=value_5)
value_6 = Parameter.Value(parameter=parameterByName_8)
round_6 = Math.Round(number=value_6)
value_7 = Parameter.Value(parameter=parameterByName_9)
round_7 = Math.Round(number=value_7)
value_8 = Parameter.Value(parameter=parameterByName_10)
round_8 = Math.Round(number=value_8)
string_from_object_4 = FromObject(obj=parameterByName_11)

# group: Lists of Variables
shape_code = Watch(toNumber)
type = Watch(toNumber_2)
A = Watch(round)
B = Watch(round_2)
C = Watch(round_3)
D = Watch(round_4)
E = Watch(round_5)
F = Watch(round_6)
L = Watch(round_7)
R = Watch(round_8)
distribution_type = Watch(string_from_object_4)

bs_8666_rebar_check = Python(IN[0]=shape_code, IN[1]=type, IN[2]=A, IN[3]=B, IN[4]=C, IN[5]=D, IN[6]=E, IN[7]=F, IN[8]=L, IN[9]=R, IN[11]=distribution_type)  # unwired: IN[10]
# ---------- bs_8666_rebar_check.python (494 lines) ----------
# Enable Python support and load DesignScript library
import clr
clr.AddReference('ProtoGeometry')
from Autodesk.DesignScript.Geometry import *


# The inputs to this node will be stored as a list in the IN variables.
dataEnteringNode = IN

# Place your code below this line

# Define Perameters 
scs = IN[0]
dias = IN[1]
a = IN[2]
b = IN[3]
c = IN[4]
d = IN[5]
e = IN[6]
f = IN[7]
l = IN[8]
r = IN[9]
elementno = IN[10]
dt = IN[11]

sc = []
dia = []


for i in range(len(scs)):
	sc.append(int(scs[i]))
	dia.append(int(dias[i]))

# Checks based on those in BS 8666

# Data tables
# Table 2, set out as d : [r, M, P (General), P (link bend <150)]
table2 = {6 : [12, 24, 110, 110],
	8 : [16, 32, 115, 115],
	10 : [20, 40, 120, 130],
	12 : [24, 48, 125, 160],
	16 : [32, 64, 130, 210],
	20 : [70, 140, 190, 290],
	25 : [87, 175, 240, 365],
	32 : [112, 224, 305, 465],
	40 : [140, 280, 380, 580],
	50 : [175, 350, 475, 725]}

# Table 6, maximum limit for radii in mm
table6 = {6 : 2500,
	8 : 2750,
	10 : 3500,
	12 : 4250,
	16 : 7500,
	20 : 14000,
	25 : 30000,
	32 : 43000,
	40 : 58000}
	
# Round up 5mm and 7mm bars to 6mm & 8mm respectively
for i in range(len(dia)):
	if dia[i] == 5:
		dia[i] = 6
	elif dia[i] == 7:
		dia[i] = 8

# Permanant Values
# Maximum length of bars, clause 7.5
lmax1 = 12000
lmax2 = 18000
# Maximum transportation lengths, clause 7.5
xmax = 2750
# Maximum radii, clause 10
rman = 200


# Set limiting perameters
# Limiting perameters based on diameter
def dimchecks (i):
	
	check = "Okay"
	comments = ""
	
	if dt[i] == "Distribution Type : Varying length":
		output = ["Varrying Length", "Bars not checked, manual check required"]	
		return output

# Check max length
	if lmax1 < l[i]:
		check = "Caution"
		comments += "Total length over " + str(lmax1) + "mm. Check avaliability with supplier. "
	elif lmax2 < l[i]:
		check = "Error"
		comments += "Rebar exceeds max length of " + str(lamx2) + "mm. "

# Set limiting factors for bar diameter	
	mindims = table2[dia[i]]
	rmin = mindims[0]
	rmax = table6[dia[i]]
	m = mindims[1]
	p1 = mindims[2]
	p2 = mindims[3]
	
# Crank checks, part 8.9
	offsetmin = 2*dia[i]
	if dia[i] > 16:
		lamin = 13*dia[i]
	else:
		lamin = 10*dia[i]
	
# Double bend checks, part 8.10
# Code finds the maximum limit. amax function not working without number python imported
	dbendminl = []
	dbendminl.append(4*dia[i]+2*r[i])
	if dia[i] > 16:
		dbendminl.append (13*dia[i])
	else:
		dbendminl.append (10*dia[i])
	dbendminl = sorted(dbendminl)
	dbendmin = dbendminl[1]
	
# Checks script
# Note: - check what r is pulled from revit
	if sc[i] == 11:
		if a[i] < p1:
			check = "Error"
			comments += "A must be greater than " + str(p1) + "mm. "
		if b[i] < p1:
			check = "Error"
			comments += "B must be greater than " + str(p1) + "mm. "
	elif sc[i] == 12:
		if a[i] < p1 or a[i] < r[i] + 6*dia[i]:
			check = "Error"
			
			#find higher limit
			lim = [p1, r[i] + 6*dia[i]]
			lim = sorted(lim)
			
			comments += "A must be greater than " + str(lim[1]) + "mm. "
		if b[i] < p1 or b[i] < r[i] + 6*dia[i]:
			check = "Error"
			
			#find higher limit
			lim = [p1, r[i] + 6*dia[i]]
			lim = sorted(lim)
			
			comments += "B must be greater than " + str(lim[1]) + "mm. "
		if r[i] < rmin:
			check = "Error"
			comments += "Radius, R, must be greater than " + str(rmin) + "mm. "
		if r[i] > rman:
			check = "Error"
			comments += "Radius, R, must be less than " + str(rman) + "mm. "
	elif sc[i] == 13:
		if a[i] < p1 or a[i] < b[i]/2 + 5 * dia[i]:
			check = "Error"
			
			#find higher limit
			lim = [p1, b[i]/2 + 5 * dia[i]]
			lim = sorted(lim)
			
			comments += "A must be greater than " + str(lim[1]) + "mm. "
		if b[i] < 2*(rmin + dia[i]):
			check = "Error"
			comments += "B must be greater than " + str(2*(rmin + dia[i])) + "mm. "
		if c[i] < p1:
			check = "Error"
			
			#find higher limit
			lim = [p1, b[i]/2 + 5 * dia[i]]
			lim = sorted(lim)
			
			comments += "C must be greater than " + str(lim[1]) + "mm. "
	elif sc[i] == 14:
		if a[i] < p1:
			check = "Error"
			comments += "A must be greater than " + str(p1) + "mm. "
		if b[i] < 2*(rmin + dia[i]):
			check = "Error"
			comments += "B must be greater than " + str(2*(rmin + dia[i])) + "mm. "
		if c[i] < p1:
			check = "Error"
			comments += "C must be greater than " + str(p1) + "mm. "			
	elif sc[i] == 15:
		if a[i] < p1:
			check = "Error"
			comments += "A must be greater than " + str(p1) + "mm. "
		if b[i] < offsetmin:
			check = "Error"
			comments += "B must be greater than " + str(offsetmin) + "mm. "
		if c[i] < p1:
			check = "Error"
			comments += "C must be greater than " + str(p1) + "mm. "
	elif sc[i] == 21 or sc[i] == 23:
		if a[i] < p1:
			check = "Error"
			comments += "A must be greater than " + str(p1) + "mm. "
		if b[i] < dbendmin:
			check = "Error"
			comments += "B must be greater than " + str(dbendmin) + "mm. "
		if c[i] < p1:
			check = "Error"
			comments += "C must be greater than " + str(p1) + "mm. "
	elif sc[i] == 22:
		if a[i] < p1:
			check = "Error"
			comments += "A must be greater than " + str(p1) + "mm. "
		if b[i] < dbendmin:
			check = "Error"
			comments += "B must be greater than " + str(dbendmin) + "mm. "
		if c[i] < 2*(rmin + dia[i]):
			check = "Error"
			comments += "C must be greater than " + str(2*(rmin + dia[i])) + "mm. "
		if d[i] < p1:
			check = "Error"
			
			#find higher limit
			lim = [p1, c[i]/2+5*dia[i]]
			lim = sorted(lim)
			
			comments += "D must be greater than " + str(lim[1]) + "mm. "
	elif sc[i] == 24:
		if a[i] < p1:
			check = "Error"
			comments += "A must be greater than " + str(p1) + "mm. "
		if b[i] < lamin:
			check = "Error"
			comments += "B must be greater than " + str(lamin) + "mm. "
		if c[i] < p1:
			check = "Error"
			comments += "C must be greater than " + str(p1) + "mm. "
		if d[i] < offsetmin:
			check = "Error"
			comments += "D must be greater than " + str(offsetmin) + "mm. "
	elif sc[i] == 25:
		if a[i] < p1:
			check = "Error"
			comments += "A must be greater than " + str(p1) + "mm. "
		if b[i] < p1:
			check = "Error"
			comments += "B must be greater than " + str(p1) + "mm. "
		if c[i] < offsetmin:
			check = "Error"
			comments += "C must be greater than " + str(offsetmin) + "mm. "
		if d[i] < offsetmin:
			check = "Error"
			comments += "D must be greater than " + str(offsetmin) + "mm. "
		if e[i] < lamin:
			check = "Error"
			comments += "E must be greater than " + str(lamin) + "mm. "
	elif sc[i] == 26:
		if a[i] < p1:
			check = "Error"
			comments += "A must be greater than " + str(p1) + "mm. "
		if b[i] < lamin:
			check = "Error"
			comments += "B must be greater than " + str(lamin) + "mm. "
		if c[i] < p1:
			check = "Error"
			comments += "C must be greater than " + str(p1) + "mm. "
		if d[i] < offsetmin:
			check = "Error"
			comments += "D must be greater than " + str(offsetmin) + "mm. "
	elif sc[i] == 27 or sc[i] == 28:
		if a[i] < p1:
			check = "Error"
			comments += "A must be greater than " + str(p1) + "mm. "
		if b[i] < lamin:
			check = "Error"
			comments += "B must be greater than " + str(lamin) + "mm. "
		if c[i] < p1:
			check = "Error"
			comments += "C must be greater than " + str(p1) + "mm. "
	elif sc[i] == 29:
		if a[i] < p1:
			check = "Error"
			comments += "A must be greater than " + str(p1) + "mm. "
		if b[i] < dbendmin:
			check = "Error"
			comments += "B must be greater than " + str(dbendmin) + "mm. "
		if c[i] < p1:
			check = "Error"
			comments += "C must be greater than " + str(p1) + "mm. "
		if d[i] < 2*(rmin + dia[i]):
			check = "Error"
			comments += "D must be greater than " + str(2*(rmin + dia[i])) + "mm. "
	elif sc[i] == 31 or sc[i] == 32:
		if a[i] < p1:
			check = "Error"
			comments += "A must be greater than " + str(p1) + "mm. "
		if b[i] < dbendmin:
			check = "Error"
			comments += "B must be greater than " + str(dbendmin) + "mm. "
		if c[i] < dbendmin:
			check = "Error"
			comments += "C must be greater than " + str(dbendmin) + "mm. "
		if d[i] < p1:
			check = "Error"
			comments += "D must be greater than " + str(p1) + "mm. "
	elif sc[i] == 33:
		if a[i] < 12 * dia[i] + 30:
			check = "Error"
			comments += "A must be greater than " + str(12 * dia[i] + 30) + "mm. "
		if b[i] < 2*(rmin + dia[i]):
			check = "Error"
			comments += "B must be greater than " + str(2*(rmin + dia[i])) + "mm. "
		if c[i] < p1 or c[i] < b[i]/2 + 5*d[i]:
			check = "Error"
			
			#find higher limit
			lim = [p1, b[i]/2 + 5*d[i]]
			lim = sorted(lim)
			
			comments += "D must be greater than " + str(lim[1]) + "mm. "
	elif sc == 34 or sc == 35:
		if a[i] < p1:
			check = "Error"
			comments += "A must be greater than " + str(p1) + "mm. "
		if b[i] < lamin:
			check = "Error"
			comments += "B must be greater than " + str(lamin) + "mm. "
		if c[i] < dbendmin:
			check = "Error"
			comments += "C must be greater than " + str(dbendmin) + "mm. "
		if d[i] < offsetmin:
			check = "Error"
			comments += "D must be greater than " + str(offsetmin) + "mm. "
		if e[i] < p1:
			check = "Error"
			comments += "E must be greater than " + str(p1) + "mm. "
	elif sc[i] == 36:
		if a[i] < p1:
			check = "Error"
			comments += "A must be greater than " + str(p1) + "mm. "
		if b[i] < dbendmin:
			check = "Error"
			comments += "B must be greater than " + str(dbendmin) + "mm. "
		if c[i] < dbendmin:
			check = "Error"
			comments += "C must be greater than " + str(dbendmin) + "mm. "
		if d[i] < p1:
			check = "Error"
			comments += "D must be greater than " + str(p1) + "mm. "
	elif sc[i] == 41 or sc[i] == 44:
		if a[i] < p1:
			check = "Error"
			comments += "A must be greater than " + str(p1) + "mm. "
		if b[i] < dbendmin:
			check = "Error"
			comments += "B must be greater than " + str(dbendmin) + "mm. "
		if c[i] < dbendmin:
			check = "Error"
			comments += "C must be greater than " + str(dbendmin) + "mm. "
		if d[i] < dbendmin:
			check = "Error"
			comments += "D must be greater than " + str(dbendmin) + "mm. "
		if e[i] < p1:
			check = "Error"
			comments += "E must be greater than " + str(p1) + "mm. "
	elif sc[i] == 46:
		if a[i] < p1:
			check = "Error"
			comments += "A must be greater than " + str(p1) + "mm. "
		if b[i] < lamin:
			check = "Error"
			comments += "B must be greater than " + str(lamin) + "mm. "
		if c[i] < dbendmin:
			check = "Error"
			comments += "C must be greater than " + str(dbendmin) + "mm. "
		if d[i] < offsetmin:
			check = "Error"
			comments += "D must be greater than " + str(offsetmin) + "mm. "
		if e[i] < p1:
			check = "Error"
			comments += "E must be greater than " + str(p1) + "mm. "
	elif sc[i] == 47:
		if a[i] < dbendmin:
			check = "Error"
			comments += "A must be greater than " + str(dbendmin) + "mm. "
		if b[i] < dbendmin:
			check = "Error"
			comments += "B must be greater than " + str(dbendmin) + "mm. "
		if c[i] != d:
			check = "Error"
			comments += "C must equal D. "
		if c[i] > a[i]:
			check = "Error"
			comments += "C must be less than A. "
		if c[i] < p1:
			check = "Error"
			comments += "C must be greater than " + str(p1) + "mm. "
		if d[i] > a[i]:
			check = "Error"
			comments += "A must be less than A. "
		if d[i] < p1:
			check = "Error"
			comments += "D must be greater than " + str(p1) + "mm. "
	elif sc[i] == 51 or sc[i] == 63:
		if a[i] < dbendmin:
			check = "Error"
			comments += "A must be greater than " + str(dbendmin) + "mm. "
		if b[i] < dbendmin:
			check = "Error"
			comments += "B must be greater than " + str(dbendmin) + "mm. "
		if c[i] < p2:
			check = "Error"
			comments += "C must be greater than " + str(p2) + "mm. "
		if d[i] < p2:
			check = "Error"
			comments += "D must be greater than " + str(p2) + "mm. "
	elif sc[i] == 56:
		if a[i] < dbendmin:
			check = "Error"
			comments += "A must be greater than " + str(dbendmin) + "mm. "
		if b[i] < dbendmin:
			check = "Error"
			comments += "B must be greater than " + str(dbendmin) + "mm. "
		if c[i] < dbendmin:
			check = "Error"
			comments += "C must be greater than " + str(dbendmin) + "mm. "
		if d[i] < dbendmin:
			check = "Error"
			comments += "D must be greater than " + str(dbendmin) + "mm. "
		if e[i] != f[i]:
			check = "Error"
			comments += "E must equal F. "
		if e[i] > b[i] or e[i] > c[i]:
			check = "Error"
			
			#find higher limit
			lim = [b[i], c[i]]
			lim = sorted(lim)
			
			comments += "E must be less than " + str(lim[1]) + "mm. "
		if e[i] < p2:
			check = "Error"
			comments += "E must be greater than " + str(p2) + "mm. "
	elif sc[i] == 64:
		if a[i] < p2:
			check = "Error"
			comments += "A must be greater than " + str(p2) + "mm. "
		if b[i] < dbendmin:
			check = "Error"
			comments += "B must be greater than " + str(dbendmin) + "mm. "
		if c[i] < dbendmin:
			check = "Error"
			comments += "C must be greater than " + str(dbendmin) + "mm. "
		if d[i] < dbendmin:
			check = "Error"
			comments += "D must be greater than " + str(dbendmin) + "mm. "
		if e[i] < dbendmin:
			check = "Error"
			comments += "E must be greater than " + str(dbendmin) + "mm. "
		if f[i] < p2:
			check = "Error"
			comments += "F must be greater than " + str(p2) + "mm. "
	elif sc[i] == 67:
		if r[i] < rmin:
			check = "Error"
			comments += "Radius, R, must be greater than " + str(rmin) + "mm. "
		if r[i] > rmax:
			check = "Error"
			comments += "Radius, R, must be less than " + str(rmax) + "mm. "
	elif sc[i] == 75 or sc[i] == 77 or sc[i] == 99:
		check = "No checks currently performed"
		comments = check
	elif sc[i] == 98:
		if a[i] < dbendmin:
			check = "Error"
			comments += "A must be greater than " + str(dbendmin) + "mm. "
		if b[i] < dbendmin:
			check = "Error"
			comments += "B must be greater than " + str(dbendmin) + "mm. "
		if c[i] < p1:
			check = "Error"
			comments += "C must be greater than " + str(p1) + "mm. "
		if d[i] < p1:
			check = "Error"
			comments += "D must be greater than " + str(p1) + "mm. "
	
	return [check, comments]

errors = []
checks = []

for i in range(len(sc)):
	check = dimchecks(i)
	errors.append(check[0])
	checks.append(check[1])

output = [errors, checks]

# Assign your output to the OUT variable.
OUT = output
# ----------------------------------------
code_block_16 = CodeBlock(list=bs_8666_rebar_check) { list[0]; list[1]; }

# group: Freeze here if Revit gives and error message and try again
freezing_this_block_will_disable = CodeBlock(assessment=code_block_16.out0, comments=code_block_16.out1, elements=filter) { assessment; comments; elements; }  # "Freezing this block will disable parameter updates (assessment, comments and date)"

# group: Update Rebar Parameters
code_block_17 = CodeBlock { "BS_8666_Check_Comments"; }
setParameterByName = Element.SetParameterByName(element=freezing_this_block_will_disable.elements, parameterName=code_block_17, value=freezing_this_block_will_disable.comments)
code_block_18 = CodeBlock { "BS_8666_Check_Assessment"; }
setParameterByName_2 = Element.SetParameterByName(element=freezing_this_block_will_disable.elements, parameterName=code_block_18, value=freezing_this_block_will_disable.assessment)
code_block_19 = CodeBlock { "BS_8666_Check_Date"; }
now = DateTime.Now()
string_from_object_5 = FromObject(obj=now)

setParameterByName_3 = Element.SetParameterByName(element=freezing_this_block_will_disable.elements, parameterName=code_block_19, value=string_from_object_5)

# group: Colour Output
color_palette = ColorPalette({R: 0, G: 128, B: 0, A: 255})
color_palette_2 = ColorPalette({R: 255, G: 215, B: 0, A: 255})
color_palette_3 = ColorPalette({R: 220, G: 20, B: 60, A: 255})
color_palette_4 = ColorPalette({R: 30, G: 144, B: 255, A: 255})
code_block_20 = CodeBlock(Okay=color_palette, Caution=color_palette_2, Error=color_palette_3, CannotCheck=color_palette_4)
# ---------- code_block_20.designscript (4 lines) ----------
[Okay,
Caution,
Error,
CannotCheck];
# ----------------------------------------
count = List.Count(list=code_block_20)
code_block_21 = CodeBlock(count=count) { 0..1..1/(count-1); }
colour_values = Python(IN[0]=code_block_16.out0)
# ---------- colour_values.python (26 lines) ----------
# Enable Python support and load DesignScript library
import clr
clr.AddReference('ProtoGeometry')
from Autodesk.DesignScript.Geometry import *

# The inputs to this node will be stored as a list in the IN variables.
dataEnteringNode = IN

# Place your code below this line
item = IN[0]
output = []

for i in item:
	if i.lower() == "okay":
		x = 0
	elif i.lower() == "caution":
		x = 0.33
	elif i.lower() == "error":
		x = 0.66
	else:
		x = 1
	
	output.append(x)

# Assign your output to the OUT variable.
OUT = output
# ----------------------------------------
color_range = ColorRange(colors=code_block_20, indices=code_block_21, value=colour_values)
overrideColorInView = Element.OverrideColorInView(element=filter, color=color_range)

# group: Disregard mesh elements (searches for "mesh" in the comments)
code_block_22 = CodeBlock { "Comments"; }
parameterByName_12 = Parameter.ParameterByName(element=filter, name=code_block_22)
string_from_object_6 = FromObject(obj=parameterByName_12)
code_block_23 = CodeBlock { 0; }
code_block_24 = CodeBlock { 11; }
remove_3 = String.Remove(str=string_from_object_6, startIndex=code_block_23, count=code_block_24)
colour_values_2 = Python(IN[0]=overrideColorInView, IN[1]=remove_3)
# ---------- colour_values_2.python (19 lines) ----------
# Enable Python support and load DesignScript library
import clr
clr.AddReference('ProtoGeometry')
from Autodesk.DesignScript.Geometry import *

# The inputs to this node will be stored as a list in the IN variables.
dataEnteringNode = IN

# Place your code below this line
elements = IN[0]
comments = IN[1]
output = []

for i in range(len(comments)):
	if comments[i].lower() == "mesh":
		output.append(elements[i])

# Assign your output to the OUT variable.
OUT = output
# ----------------------------------------
current_2 = Document.Current()
activeView_2 = Document.ActiveView(document=current_2)
boolean_3 = BoolSelector(false)
setSolidInView_2 = Custom[Rebar.SetSolidInView](rebarElements=colour_values_2, views=activeView_2, solid=boolean_3)
integer_slider = IntegerSlider(60, range=1..100 step 1)
boolean_4 = BoolSelector(true)
byProperties = Revit.Filter.OverrideGraphicSettings.ByProperties(transparency=integer_slider, halftone=boolean_4)
overrideInView = Element.OverrideInView(element=colour_values_2, overrides=byProperties)
boolean_5 = BoolSelector(false)
setUnobscuredInView_2 = Custom[Rebar.SetUnobscuredInView](rebarElements=colour_values_2, views=activeView_2, unobscured=boolean_5)
