# Dynamo graph Rebar Check Setup.dyn "Rebar Check Setup v0.1" (Dynamo 2.0.2.6826)

# group: Create New Parameters
code_block = CodeBlock { "BS_8666_Check_Date"; "Rebar_Checks"; "Text"; "PG_TEXT"; }
boolean = BoolSelector(true)
categories = Categories(index=556)
createProjectParameter = Parameter.CreateProjectParameter(parameterName=code_block.out0, groupName=code_block.out1, type=code_block.out2, group=code_block.out3, instance=boolean, categoryList=categories)
code_block_2 = CodeBlock { "BS_8666_Check_Comments"; "Rebar_Checks"; "Text"; "PG_TEXT"; }
boolean_2 = BoolSelector(true)
categories_2 = Categories(index=556)
createProjectParameter_2 = Parameter.CreateProjectParameter(parameterName=code_block_2.out0, groupName=code_block_2.out1, type=code_block_2.out2, group=code_block_2.out3, instance=boolean_2, categoryList=categories_2)
code_block_3 = CodeBlock { "BS_8666_Check_Assessment"; "Rebar_Checks"; "Text"; "PG_TEXT"; }
boolean_3 = BoolSelector(true)
categories_3 = Categories(index=556)
createProjectParameter_3 = Parameter.CreateProjectParameter(parameterName=code_block_3.out0, groupName=code_block_3.out1, type=code_block_3.out2, group=code_block_3.out3, instance=boolean_3, categoryList=categories_3)
